# Dynamo graph Railing.dyn (Dynamo 0.7.3.3034)

railing_length_front = DoubleSlider(10.973, range=0..100)
panels_gap = DoubleSlider(0.1, range=0..0.5)
panels_count_front = IntegerSlider(9, range=0..100)
railing_height = DoubleSlider(1.067, range=0..2)
railing_panel_thickness = DoubleSlider(0.01, range=0..1)
logo = CodeBlock()
# ---------- logo.designscript (6 lines) ----------
//Logo
Logo=PolyCurve.ByJoinedCurves({Line.ByStartPointEndPoint(Point.ByCoordinates(0,0,0),Point.ByCoordinates(0,0,1.25)),Line.ByStartPointEndPoint(Point.ByCoordinates(0,0,0),Point.ByCoordinates(1,0,0)),Line.ByStartPointEndPoint(Point.ByCoordinates(1,0,0),Point.ByCoordinates(1,0,-0.25)),Arc.ByCenterPointStartPointEndPoint(Point.ByCoordinates(0,0,-0.25),Point.ByCoordinates(1,0,-0.25),Point.ByCoordinates(0,0,-1.25)),Line.ByStartPointEndPoint(Point.ByCoordinates(0,0,-1.25),Point.ByCoordinates(0,0,-0.25)),Arc.ByCenterPointStartPointEndPoint(Point.ByCoordinates(0,0,0.25),Point.ByCoordinates(0,0,1.25),Point.ByCoordinates(1,0,0.25))});
Logo=PolyCurve.ByThickeningCurve(Logo,0.2,Vector.YAxis());
Logo=Surface.ByPatch(Logo);
Logo=Logo.Scale(0.0125);
Logo=Logo.Thicken(0.1,1);
# ----------------------------------------
railing_length_side = DoubleSlider(3.048, range=0..100)
panels_count_side = IntegerSlider(3, range=0..100)
railing_panels = CodeBlock(railing_length_front, panels_gap, panels_count_front, railing_height, railing_panel_thickness, logo, railing_length_side, panels_count_side)
# ---------- railing_panels.designscript (47 lines) ----------
//Function:Shuffle List
def FnShu(li:var[])
{
return=List.Shuffle(li);
}

//Function:Randomize List
def FnRan(li:var[])
{
r1=Math.Round(Math.Random(2,6));
r2=Math.Round(Math.Random(0,4));
return=List.DropEveryNthItem(li,r1,r2);
}

//Function:RailingPanels
def FnPanels(Len,Gap,Cnt,Hgt,Thk,CutSol)
{
PnlLen=(Len-(Gap*Cnt))/Cnt;
PnlX=(0+Gap)..(Len-PnlLen-Gap)..#Cnt;
PnlPntX=Point.ByCoordinates(PnlX,0,0);
PnlLin=Line.ByStartPointDirectionLength(PnlPntX,Vector.XAxis(),PnlLen);
PnlSur=PnlLin.Extrude(Vector.ZAxis(),Hgt);
PnlSld=PnlSur.Thicken(Thk,true);
PnlCen=PnlSld.Centroid();
//Center Randomization
r1=(Math.RandomList(Cnt)*PnlLen/3)*Math.Random(-1,1);
r2=(Math.RandomList(Cnt)*Hgt/3)*Math.Random(-1,1);
a=(PnlCen.X)+r1;
b=(PnlCen.Z)+r2;
PanelCen=Point.ByCoordinates(a<1>,0,b<1>);
//Clusters
CutSol1=CutSol.Transform(CoordinateSystem.Identity(),CoordinateSystem.ByOrigin(Point.ByCylindricalCoordinates(CoordinateSystem.ByPlane(Plane.XZ()),(15..375..#10)<1>,0,{0.125,0.2,0.3,0.5,0.75,1}<2>)));
CutSol2=CutSol.Transform(CoordinateSystem.Identity(),CoordinateSystem.ByOrigin(Point.ByCylindricalCoordinates(CoordinateSystem.ByPlane(Plane.XZ()),(0..360..#11)<1>,0,{0.075,0.15,0.25,0.425,0.6,0.875}<2>)));
CutSols=List.Shuffle(Flatten({CutSol,CutSol1,CutSol2}));
Clusterf=CutSols<1>.Transform(CoordinateSystem.Identity(),CoordinateSystem.ByOrigin(PanelCen)<2>);
Clustert=List.Transpose(Clusterf);
Clustert1=FnShu(Clustert);
Clustert2=FnRan(Clustert1);
ClusterSld=Solid.ByUnion(Clustert2);
return=PnlSld.Difference(ClusterSld);
}

rlF=FnPanels(Len,Gap,Cnt,Hgt,Thk,CutSol);
rlL=((FnPanels(LenS,Gap,CntS,Hgt,Thk,CutSol)).Rotate(Plane.XY(),-90)).Translate(Vector.YAxis(),LenS);
rlR=((FnPanels(LenS,Gap,CntS,Hgt,Thk,CutSol)).Rotate(Plane.XY(),90)).Translate(Vector.XAxis(),Len);

Railing=Solid.ByUnion(Flatten({rlF,rlL,rlR}));
# ----------------------------------------
code_block = CodeBlock(Railing=railing_panels.out3) { Railing; }
byGeometry = ImportInstance.ByGeometry(code_block)
